# Grasshopper definition RAMit.gh (Grasshopper 1.0.7)
# plug-ins: RhinoCodePluginGH

# ----
# Create New Model
# Connect to Existing Model
boolean_toggle = BooleanToggle(True)
file_path = FilePath("C:\Users\alahri\")
createnewfile = Script(userDirectory=file_path, fileName="Example1", createNewFile=boolean_toggle)  # -> out, file_path; inputs createNewFile: Boolean; disabled
# ---------- createnewfile: Python ----------
"""Grasshopper Script"""
"""Grasshopper Script"""
# requirements: requests
# env: C:\Program Files\Bentley\Engineering\RAM Concept CONNECT Edition\RAM Concept CONNECT Edition V8\python
# Python Imports
import System
import Rhino
import Grasshopper

import rhinoscriptsyntax as rs

import os
from math import pi
from pathlib import Path


class MyComponent(Grasshopper.Kernel.GH_ScriptInstance):
    def RunScript(self, userDirectory, fileName, createNewFile: bool):
        # RAM Concept API imports
        user_directory = str(userDirectory)
        file_name=str(fileName)+".cpt"
        file_path = os.path.join(user_directory, file_name)
        if createNewFile==True:
            from ram_concept.concept import Concept
            from ram_concept.model import DesignCode
            from ram_concept.model import Model
            from ram_concept.model import StructureType
            
                    
            # SET include_pt BELOW TO False TO AVOID USING A PT LICENSE
            include_pt = True
            
            # STARTUP RAM CONCEPT AND CREATE A FILE
            
            # The first thing to do is always to start a RAM Concept process to act as a server.
            # In production, you will normally want to use a headless server, but for debugging you might want to run RAM Concept with a GUI.
            concept = Concept.start_concept(headless=True)
            #concept = Concept.start_concept(headless=False)
            
            # You'll either want to open a file or create a new one.
            model = concept.new_model()
            #model = concept.open_file(file_path)
            
            # If this is a new file/model, you will want to initialize it for the desired code, structure type and unit system.
            # The bare-bones file/model created by new_model() is extremely minimal (almost useless)
            model.setup_new_model(DesignCode.ACI318_19US, StructureType.ELEVATED)
            
            # SETUP / SAVE UNITS AND SIGNS
            
            # Set the units to something appropriate for the user (if this was an existing file you would assume the units are ok)
            units = model.units
            units.set_US_user_units()
            
            # Save the units, as you are about to change them and want to restore them before saving the file
            saved_units = units.get_units()
            
            # Set the units to something predictable for the API (the API uses the same units as the UI)
            units.set_US_API_units() # meters, degrees, Newtons, kilograms, seconds, Celsius
            
            # Set the signs to something appropriate for the user (if this was an existing file you would assume the units are ok)
            signs = model.signs
            signs.set_standard_signs()
            
            # Save the signs, as you are about to change them and want to restore them before saving the file
            saved_signs = signs.get_signs()
            
            # Set the signs to somethign predictable for the API (the API uses the same units as the UI)
            signs.set_positive_signs()
            
            # RESTORE THE UNITS AND SIGNS
            
            # restore the units to the initial user-friendly units
            units.set_units(saved_units)
            
            # restore the signs to the initial user-friendly signs
            signs.set_signs(saved_signs)
            
            # SAVE THE FILE
            
            model.save_file(file_path)
            
            # SHUT DOWN RAM CONCEPT
            
            concept.shut_down()
            return file_path
        else:
            return user_directory
# ---------- end createnewfile ----------

# ----
# This component lets you draw
# Slabs in RAM Concept
panel = Panel("16")
value_list = ValueList({"One Way": 1, "Two Way": 2}, selected="Two Way")
drawslab = Script(SlabThickness=panel, ConcreteMaterial="3000 psi", SlabPriority="1", TopOfConcrete="0", SlabBehavior=value_list)  # -> out, a; inputs SlabVertices: list of Point3d, SlabThickness: Double, ConcreteMaterial: String, SlabPriority: Int32, TopOfConcrete: Double, SlabBehavior: Int32; disabled
# ---------- drawslab: Python ----------
"""Grasshopper Script Instance"""
import System
import Rhino
import Grasshopper

import rhinoscriptsyntax as rs



class MyComponent(Grasshopper.Kernel.GH_ScriptInstance):
    def RunScript(self,
            FilePath,
            SlabVertices: System.Collections.Generic.IEnumerable[Rhino.Geometry.Point3d],
            SlabThickness: float,
            ConcreteMaterial: str,
            SlabPriority: int,
            TopOfConcrete: float,
            SlabBehavior: int):
        # requirements: requests
        # env: C:\Program Files\Bentley\Engineering\RAM Concept CONNECT Edition\RAM Concept CONNECT Edition V8\python
        
        # RAM Concept API imports
        from ram_concept.concept import Concept
        from ram_concept.model import DesignCode
        from ram_concept.model import Model
        from ram_concept.model import StructureType
        from ram_concept.point_2D import Point2D
        from ram_concept.polygon_2D import Polygon2D
        from ram_concept.slab_area import DefaultSlabArea
        from ram_concept.slab_area import SlabAreaBehavior

        
        import os
        from pathlib import Path

        print("1")
        concept = Concept.start_concept(headless=True)
        model = concept.open_file(FilePath)
        
        print("1")
        cad_manager = model.cad_manager
        structure_layer = cad_manager.structure_layer

        default_slab_area = cad_manager.default_slab_area
        
        default_slab_area.thickness = SlabThickness
        default_slab_area.toc = TopOfConcrete
        if SlabBehavior ==1:
            default_slab_area.behavior = SlabAreaBehavior.ONE_WAY_SLAB
        else:
            default_slab_area.behavior = SlabAreaBehavior.TWO_WAY_SLAB
            print(SlabBehavior)

        concretes = model.concretes
        default_slab_area.concrete = concretes.concrete(ConcreteMaterial)
        default_slab_area.priority = SlabPriority
        default_slab_area.r_axis = 0.0

        # Add Slab in the project
        List1 = SlabVertices
        List2 = [Point2D(coord.X, coord.Y) for coord in List1]
        slab_location = Polygon2D(List2)
        slab_area = structure_layer.add_slab_area(slab_location)

        model.generate_mesh()

        model.save_file(FilePath)
        concept.shut_down()
        return
# ---------- end drawslab ----------

# ----
# This component lets you draw
# Walls in RAM Concept
panel_2 = Panel("24")
drawwalls = Script(t=panel_2, height="9", ConcreteMaterial="3000 psi")  # -> out, a; inputs Wall3DPoint: tree of Point3d, t: Double, height: Double, ConcreteMaterial: String; disabled
# ---------- drawwalls: Python ----------
"""Grasshopper Script Instance"""
import System
import Rhino
import Grasshopper

import rhinoscriptsyntax as rs



class MyComponent(Grasshopper.Kernel.GH_ScriptInstance):
    def RunScript(self,
            FilePath,
            Wall3DPoint: Grasshopper.DataTree[Rhino.Geometry.Point3d],
            t: float,
            height: float,
            BelowSlab: bool,
            ConcreteMaterial: str):
        # requirements: requests
        # env: C:\Program Files\Bentley\Engineering\RAM Concept CONNECT Edition\RAM Concept CONNECT Edition V8\python
        
        # RAM Concept API imports
        from ram_concept.concept import Concept
        from ram_concept.model import DesignCode
        from ram_concept.model import Model
        from ram_concept.model import StructureType
        from ram_concept.point_2D import Point2D
        from ram_concept.polygon_2D import Polygon2D
        from ram_concept.slab_area import DefaultSlabArea
        from ram_concept.slab_area import SlabAreaBehavior
        from ram_concept.line_segment_2D import LineSegment2D

        
        import os
        from pathlib import Path
        
        concept = Concept.start_concept(headless=True)
        model = concept.open_file(FilePath)
        
        cad_manager = model.cad_manager
        structure_layer = cad_manager.structure_layer
        
        default_wall = cad_manager.default_wall
        default_wall.below_slab = True
        default_wall.compressible = True
        concretes = model.concretes
        concrete_45 = concretes.concrete(ConcreteMaterial)
        default_wall.height = height
        default_wall.fixed_near = False
        default_wall.fixed_far = False
        default_wall.shear_wall = True
        default_wall.thickness = t
        default_wall.use_specified_LLR_parameters = False
        
        b=[]
        c=[]
        for i in range(Wall3DPoint.BranchCount):
            branchList = Wall3DPoint.Branch(i)
                      

            for j in range(branchList.Count):
                s = branchList[j]
                #print(s)
                List1 = Point2D(s.X, s.Y)
                b.append(List1)
            c.append(b)
            b=[]
        
        print(len(c))
        
        for walls in range(len(c)):
            
            
            
            pt1 = c[walls][0]
            pt2 = c[walls][1]
            print(pt1,pt2)
            structure_layer.add_wall(LineSegment2D(pt1,pt2))
        
            



        model.generate_mesh()

        model.save_file(FilePath)
        concept.shut_down()
        return
# ---------- end drawwalls ----------

# ----
# This component lets you draw
# Columns in RAM Concept
boolean_toggle_2 = BooleanToggle(True)
drawcolumns = Script(b="24", d="24", height="9", ColumnAngle="0", BelowSlab=boolean_toggle_2, ConcreteMaterial="3000 psi")  # -> out, a; inputs Column3DPoint: list of Point3d, b: Double, d: Double, height: Double, ColumnAngle: Boolean, BelowSlab: Boolean, ConcreteMaterial: String; disabled
# ---------- drawcolumns: Python ----------
"""Grasshopper Script Instance"""
import System
import Rhino
import Grasshopper

import rhinoscriptsyntax as rs



class MyComponent(Grasshopper.Kernel.GH_ScriptInstance):
    def RunScript(self,
            FilePath,
            Column3DPoint: System.Collections.Generic.IEnumerable[Rhino.Geometry.Point3d],
            b: float,
            d: float,
            height: float,
            ColumnAngle: bool,
            BelowSlab: bool,
            ConcreteMaterial: str):
        # requirements: requests
        # env: C:\Program Files\Bentley\Engineering\RAM Concept CONNECT Edition\RAM Concept CONNECT Edition V8\python
        
        # RAM Concept API imports
        from ram_concept.concept import Concept
        from ram_concept.model import DesignCode
        from ram_concept.model import Model
        from ram_concept.model import StructureType
        from ram_concept.point_2D import Point2D
        from ram_concept.polygon_2D import Polygon2D
        from ram_concept.slab_area import DefaultSlabArea
        from ram_concept.slab_area import SlabAreaBehavior

        
        import os
        from pathlib import Path

        concept = Concept.start_concept(headless=True)
        model = concept.open_file(FilePath)
        
        cad_manager = model.cad_manager
        structure_layer = cad_manager.structure_layer

        default_slab_area = cad_manager.default_slab_area
        
            # set the values for columns to be added
        default_column = cad_manager.default_column
        default_column.angle = ColumnAngle
        default_column.below_slab = BelowSlab
        default_column.compressible = True
        concretes = model.concretes
        default_slab_area.concrete = concretes.concrete(ConcreteMaterial)
        default_column.b = b
        default_column.d = d
        default_column.height = height
        default_column.i_factor = 1.0
        default_column.fixed_near = True
        default_column.fixed_far = True
        default_column.roller = False
        default_column.use_specified_LLR_parameters = False

        List1 = Column3DPoint
        List2 = [Point2D(coord.X, coord.Y) for coord in List1]

        column_points = List2
        for column_point in column_points:
            structure_layer.add_column(column_point)

        model.generate_mesh()

        model.save_file(FilePath)
        concept.shut_down()
        return
# ---------- end drawcolumns ----------

# ----
# This component lets you draw
# Openings in RAM Concept
drawopening = Script()  # -> out, a; inputs SlabVertices: list of Point3d; disabled
# ---------- drawopening: Python ----------
"""Grasshopper Script Instance"""
import System
import Rhino
import Grasshopper

import rhinoscriptsyntax as rs



class MyComponent(Grasshopper.Kernel.GH_ScriptInstance):
    def RunScript(self,
            FilePath,
            SlabVertices: System.Collections.Generic.IEnumerable[Rhino.Geometry.Point3d]):
        # requirements: requests
        # env: C:\Program Files\Bentley\Engineering\RAM Concept CONNECT Edition\RAM Concept CONNECT Edition V8\python
        
        # RAM Concept API imports
        from ram_concept.concept import Concept
        from ram_concept.model import DesignCode
        from ram_concept.model import Model
        from ram_concept.model import StructureType
        from ram_concept.point_2D import Point2D
        from ram_concept.polygon_2D import Polygon2D
        from ram_concept.slab_area import DefaultSlabArea
        from ram_concept.slab_opening import DefaultSlabOpening
        from ram_concept.slab_area import SlabAreaBehavior

        
        import os
        from pathlib import Path

        concept = Concept.start_concept(headless=True)
        model = concept.open_file(FilePath)
        
        cad_manager = model.cad_manager
        structure_layer = cad_manager.structure_layer

        default_slab_opening = cad_manager.default_slab_opening
        

        # Add Slab in the project
        List1 = SlabVertices
        List2 = [Point2D(coord.X, coord.Y) for coord in List1]
        print("jksdf")
        slab_location = Polygon2D(List2)
        print(slab_location)
        #slab_area = structure_layer.add_slab_area(slab_location)
        slab_area = structure_layer.add_slab_opening(slab_location)
        

        model.generate_mesh()

        model.save_file(FilePath)
        concept.shut_down()
        return
# ---------- end drawopening ----------
