# Grasshopper definition RevitToRamConcept_V009.gh (Grasshopper 1.0.7)
# plug-ins: Rhino.Inside for Autodesk Revit, RhinoCodePluginGH

built_in_categories = BuiltInCategories("autodesk.revit.category.family:structuralColumns-1.0.0", SearchPattern="structural columns")
pick_floor = Slider(2, range=1..4)
built_in_categories_2 = BuiltInCategories("autodesk.revit.category.local:levels-1.0.0", SearchPattern="levels")
built_in_categories_3 = BuiltInCategories("autodesk.revit.category.local:walls-1.0.0", SearchPattern="Walls")
built_in_categories_4 = BuiltInCategories("autodesk.revit.category.local:floors-1.0.0", SearchPattern="Floor")
built_in_categories_5 = BuiltInCategories("autodesk.revit.category.local:shaftOpening-1.0.0", SearchPattern="shaft")
category_filter = CategoryFilter(Categories=built_in_categories_3, Inverted=False)
category_filter_2 = CategoryFilter(Categories=built_in_categories_4, Inverted=False)
category_filter_3 = CategoryFilter(Categories=built_in_categories, Inverted=False)
category_filter_4 = CategoryFilter(Categories=built_in_categories_2, Inverted=False)
category_filter_5 = CategoryFilter(Categories=built_in_categories_5, Inverted=False)
query_elements = QueryElements(Filter=category_filter, Limit=100)  # -> Elements, Count
query_elements_2 = QueryElements(Filter=category_filter_2, Limit=100)  # -> Elements, Count
query_elements_3 = QueryElements(Filter=category_filter_4, Limit=100)  # -> Elements, Count
query_elements_4 = QueryElements(Filter=category_filter_5, Limit=100)  # -> Elements, Count
query_elements_5 = QueryElements(Filter=category_filter_3, Limit=100)  # -> Elements, Count
element_curve = ElementCurve(Element=query_elements_5.Elements)  # -> Element, Curve

# ----
# ①
# Get Bottom surface of Slab
element_geometry = ElementGeometry(Elements=query_elements_2.Elements)
debrep = DeconstructBrep(Brep=element_geometry)  # -> Faces, Edges, Vertices
area = Area(Geometry=debrep.Faces)  # -> Area, Centroid
pdecon = Deconstruct(Point=area.Centroid)  # -> XComponent, YComponent, ZComponent
sort = SortList(Keys=pdecon.ZComponent, ValuesA=debrep.Faces)  # -> Keys, ValuesA
reverse_list = ReverseList(List=sort.Keys)
item = ListItem(List=reverse_list, Index=0, Wrap=True)
equals = Equality(FirstNumber=pdecon.ZComponent, SecondNumber=item)  # -> Equality, Inequality
dispatch = Dispatch(List=debrep.Faces, DispatchPattern=equals.Equality)  # -> ListA, ListB
srf = Surface(dispatch.ListA)

list_item = ListItem(List=query_elements_2.Elements, Index=expr("x-1", pick_floor), Wrap=True)
list_item_2 = ListItem(List=query_elements_2.Elements, Index=expr("x+1", pick_floor), Wrap=True)
list_item_3 = ListItem(List=query_elements_2.Elements, Index=pick_floor, Wrap=True)

# ---- group: all_levels
inspect_element = InspectElement(Element=query_elements.Elements)

inspect_element_2 = InspectElement(Element=query_elements.Elements)

# ---- group: current_level
inspect_element_3 = InspectElement(Element=list_item_3)

# ---- group: below_level
inspect_element_4 = InspectElement(Element=list_item)

# ---- group: above_level
inspect_element_5 = InspectElement(Element=list_item_2)

# ----
panel = Panel(query_elements_3.Elements)
panel_2 = Panel(inspect_element_3)
panel_3 = Panel(inspect_element_4)
panel_4 = Panel(inspect_element_5)
panel_5 = Panel(inspect_element)
panel_6 = Panel(inspect_element_2)

ghpython_script = GhPythonScript(str_list=panel)  # -> minimum, maximum, roof, penthouse; inputs str_list: list
# ---------- ghpython_script: Python ----------
__author__ = "gregb"
__version__ = "2023.11.05"

import rhinoscriptsyntax as rs

level_str = []
levels = []

for str in str_list:
    line = []
    for id in str.split(" : "):
        line.append(id)
    level_str.append(line[1])


for level in level_str:
    line = []
    for keyword in level.split(" "):
        line.append(keyword)
    if line[0] == "Level":
        levels.append(int(line[1]))
    elif line[0] == "T.O.":
        levels.append(0)

minimum = min(levels)
maximum = max(levels)
roof = maximum + 1
penthouse = maximum + 2
# ---------- end ghpython_script ----------
ghpython_script_2 = GhPythonScript(str_list=panel_2, roof=ghpython_script.roof, penthouse=ghpython_script.penthouse)  # -> levels; inputs str_list: list
# ---------- ghpython_script_2: Python ----------
__author__ = "gregb"
__version__ = "2023.11.05"

import rhinoscriptsyntax as rs

level_str = []
levels = []

for str in str_list:
    line = []
    for id in str.split(" : "):
        line.append(id)
    level_str.append(line[1])


for level in level_str:
    line = []
    for keyword in level.split(" "):
        line.append(keyword)
    if line[0] == "Level":
        levels.append(int(line[1]))
    elif line[0] == "T.O.":
        levels.append(0)
    elif line[0] == "ROOF":
        levels.append(roof)
    elif line[0] == "PENTHOUSE":
        levels.append(penthouse)
# ---------- end ghpython_script_2 ----------
ghpython_script_3 = GhPythonScript(str_list=panel_3, roof=ghpython_script.roof, penthouse=ghpython_script.penthouse)  # -> levels; inputs str_list: list; same code as ghpython_script_2
ghpython_script_4 = GhPythonScript(str_list=panel_4, roof=ghpython_script.roof, penthouse=ghpython_script.penthouse)  # -> levels; inputs str_list: list; same code as ghpython_script_2
ghpython_script_5 = GhPythonScript(str_list=panel_5, roof=ghpython_script.roof, penthouse=ghpython_script.penthouse)  # -> levels; inputs str_list: list; same code as ghpython_script_2
ghpython_script_6 = GhPythonScript(str_list=panel_6, roof=ghpython_script.roof, penthouse=ghpython_script.penthouse)  # -> levels; inputs str_list: list; same code as ghpython_script_2

# ---- group: Identify Target Floor
area_2 = Area(Geometry=flatten(srf))  # -> Area, Centroid
pdecon_2 = Deconstruct(Point=area_2.Centroid)  # -> XComponent, YComponent, ZComponent
sort_2 = SortList(Keys=pdecon_2.ZComponent, ValuesA=flatten(srf))  # -> Keys, ValuesA

# ---- group: Identify Target Floor / set_above_and_below
set_surfaces = GhPythonScript(srf_list=sort_2.ValuesA, index=pick_floor)  # -> target, below, above; inputs srf_list: list of Surface, index: Int32
# ---------- set_surfaces: Python ----------
__author__ = "gregb"
__version__ = "2023.11.04"

import rhinoscriptsyntax as rs
import Rhino.Geometry as rg

target = srf_list[index]

if index == 0:
    below = None
else:
    below = srf_list[index - 1]


if index >= len(srf_list) - 1:
    above = None
else:
    above = srf_list[index + 1]
# ---------- end set_surfaces ----------

# ---- group: Identify Target Floor / target floor
list_item_4 = ListItem(List=flatten(sort_2.ValuesA), Index=pick_floor, Wrap=True)

# ----
curve = Curve(element_curve.Curve)

# ---- group: Get_Column_Coordinates
ghpython_script_7 = GhPythonScript(target_srf=set_surfaces.target, below_srf=set_surfaces.below, above_srf=set_surfaces.above, col_list=curve)  # -> base_points, below_heights, above_heights; inputs target_srf: Surface, below_srf: Surface, above_srf: Surface, col_list: list of Curve
# ---------- ghpython_script_7: Python ----------
__author__ = "gregb"
__version__ = "2023.11.04"

import rhinoscriptsyntax as rs
import Rhino.Geometry as rg

base_points = []
below_points = []
above_points = []
below_heights = []
above_heights = []

for col in col_list:
    base_intersect = rs.CurveSurfaceIntersection(col, target_srf)
    if base_intersect != None:
        base_intersect_point = base_intersect[0][1]
        base_points.append(base_intersect_point)
    if below_srf != None:
        below_intersect = rs.CurveSurfaceIntersection(col, below_srf)
        if below_intersect != None:
            below_intersect_point = below_intersect[0][1]
            below_points.append(below_intersect_point)
    if above_srf != None:
        above_intersect = rs.CurveSurfaceIntersection(col, above_srf)
        if above_intersect != None:
            above_intersect_point = above_intersect[0][1]
            above_points.append(above_intersect_point)

print(below_points)

for i in range(len(base_points)):
    if len(below_points) > 0:
        below_heights.append(base_points[i].Z - below_points[i].Z)
    if len(above_points) > 0:
        above_heights.append(above_points[i].Z - base_points[i].Z)
# ---------- end ghpython_script_7 ----------

# ----
# ②
# Get edge of slab and ignore openings
edges = BrepEdges(Brep=list_item_4)  # -> Naked, Interior, NonManifold
join = JoinCurves(Curves=edges.Naked, Preserve=False)
len = Length(Curve=join)
sort_3 = SortList(Keys=len, ValuesA=join)  # -> Keys, ValuesA
item_2 = ListItem(List=reverse(sort_3.ValuesA), Index=0, Wrap=True)
crv = Curve(item_2)

ghpython_script_8 = GhPythonScript(
    walls=query_elements.Elements,
    all_base=ghpython_script_5,
    all_top=ghpython_script_6,
    curr_lvl=ghpython_script_2,
    below_lvl=ghpython_script_3,
    above_lvl=ghpython_script_4)  # -> out, above_walls, below_walls; inputs walls: list, all_base: list of Int32, all_top: list of Int32, curr_lvl: Int32, below_lvl: Int32, above_lvl: Int32
# ---------- ghpython_script_8: Python ----------
__author__ = "gregb"
__version__ = "2023.11.04"

import rhinoscriptsyntax as rs

above_walls = []
below_walls = []

for i in range(len(walls)):
    base = all_base[i]
    top = all_top[i]
    if base <= curr_lvl and top >= above_lvl:
        above_walls.append(walls[i])
    if top >= curr_lvl and base <= below_lvl:
        below_walls.append(walls[i])
# ---------- end ghpython_script_8 ----------
element_curve_2 = ElementCurve(Element=ghpython_script_8.below_walls)  # -> Element, Curve
element_curve_3 = ElementCurve(Element=ghpython_script_8.above_walls)  # -> Element, Curve
curve_2 = Curve(element_curve_2.Curve)
curve_3 = Curve(element_curve_3.Curve)
end_points = EndPoints(Curve=curve_2)  # -> graft(Start), graft(End)
end_points_2 = EndPoints(Curve=curve_3)  # -> graft(Start), graft(End)

file_path = FilePath("C:\Users\alahri\")

# ----
# ③
# Approximate slab edge with linear segments
# and Scale
number_slider = Slider(150, range=10..1000)
divide = DivideCurve(Curve=crv, Count=number_slider, Kinks=Toggle(True))  # -> Points, Tangents, Parameters
pline = PolyLine(Vertices=divide.Points, Closed=True)
scale = Scale(Geometry=pline, Center=Point(0, 0, 0), Factor=Slider(1, range=0..100))  # -> Geometry, Transform
disc = Discontinuity(Curve=scale.Geometry, Level=1)  # -> Points, Parameters

# ---- group: above walls
merge = Merge(Data1=end_points_2.Start, Data2=end_points_2.End)  # -> simplify(Result)

# ---- group: below walls
merge_2 = Merge(Data1=end_points.Start, Data2=end_points.End)  # -> simplify(Result)

# ----
createnewfile = Script(userDirectory=file_path, fileName="Example5", createNewFile=Toggle(True))  # -> out, file_path; inputs createNewFile: Boolean
# ---------- createnewfile: Python ----------
"""Grasshopper Script"""
"""Grasshopper Script"""
# requirements: requests
# env: C:\Program Files\Bentley\Engineering\RAM Concept CONNECT Edition\RAM Concept CONNECT Edition V8\python
# Python Imports
import System
import Rhino
import Grasshopper

import rhinoscriptsyntax as rs

import os
from math import pi
from pathlib import Path


class MyComponent(Grasshopper.Kernel.GH_ScriptInstance):
    def RunScript(self, userDirectory, fileName, createNewFile: bool):
        # RAM Concept API imports
        user_directory = str(userDirectory)
        file_name=str(fileName)+".cpt"
        file_path = os.path.join(user_directory, file_name)
        if createNewFile==True:
            from ram_concept.concept import Concept
            from ram_concept.model import DesignCode
            from ram_concept.model import Model
            from ram_concept.model import StructureType
            
                    
            # SET include_pt BELOW TO False TO AVOID USING A PT LICENSE
            include_pt = True
            
            # STARTUP RAM CONCEPT AND CREATE A FILE
            
            # The first thing to do is always to start a RAM Concept process to act as a server.
            # In production, you will normally want to use a headless server, but for debugging you might want to run RAM Concept with a GUI.
            concept = Concept.start_concept(headless=True)
            #concept = Concept.start_concept(headless=False)
            
            # You'll either want to open a file or create a new one.
            model = concept.new_model()
            #model = concept.open_file(file_path)
            
            # If this is a new file/model, you will want to initialize it for the desired code, structure type and unit system.
            # The bare-bones file/model created by new_model() is extremely minimal (almost useless)
            model.setup_new_model(DesignCode.ACI318_19US, StructureType.ELEVATED)
            
            # SETUP / SAVE UNITS AND SIGNS
            
            # Set the units to something appropriate for the user (if this was an existing file you would assume the units are ok)
            units = model.units
            units.set_US_user_units()
            
            # Save the units, as you are about to change them and want to restore them before saving the file
            saved_units = units.get_units()
            
            # Set the units to something predictable for the API (the API uses the same units as the UI)
            units.set_US_API_units() # meters, degrees, Newtons, kilograms, seconds, Celsius
            
            # Set the signs to something appropriate for the user (if this was an existing file you would assume the units are ok)
            signs = model.signs
            signs.set_standard_signs()
            
            # Save the signs, as you are about to change them and want to restore them before saving the file
            saved_signs = signs.get_signs()
            
            # Set the signs to somethign predictable for the API (the API uses the same units as the UI)
            signs.set_positive_signs()
            
            # RESTORE THE UNITS AND SIGNS
            
            # restore the units to the initial user-friendly units
            units.set_units(saved_units)
            
            # restore the signs to the initial user-friendly signs
            signs.set_signs(saved_signs)
            
            # SAVE THE FILE
            
            model.save_file(file_path)
            
            # SHUT DOWN RAM CONCEPT
            
            concept.shut_down()
            return file_path
        else:
            return user_directory
# ---------- end createnewfile ----------
value_list = ValueList({"One Way": 1, "Two Way": 2}, selected="Two Way")
panel_7 = Panel("24")
panel_8 = Panel("0")
boolean_toggle = BooleanToggle(True)
boundary_surfaces = BoundarySurfaces(Edges=scale.Geometry)

opening_boundary_profile = OpeningBoundaryProfile(Opening=query_elements_4.Elements)  # -> Plane, Profile
length = Length(Curve=opening_boundary_profile.Profile)
sort_list = SortList(Keys=length, ValuesValuesA=opening_boundary_profile.Profile)  # -> reverse(Keys), reverse(ValuesValuesA)
srf_2 = Surface(boundary_surfaces)
area_3 = Area(Geometry=srf_2)  # -> Area, Centroid
list_item_5 = ListItem(List=sort_list.ValuesValuesA, Index=Slider(0, range=0..2), Wrap=True)
curve_4 = Curve(list_item_5)
project = Project(Geometry=curve_4, Plane=area_3.Centroid)  # -> Geometry, Transform
discontinuity = Discontinuity(Curve=project.Geometry, Level=1)  # -> simplify(Points), Parameters

drawslab = Script(
    FilePath=createnewfile.file_path,
    SlabVertices=disc.Points,
    SlabThickness="16",
    ConcreteMaterial="3000 psi",
    SlabPriority="1",
    TopOfConcrete="0",
    SlabBehavior=value_list)  # -> out, a; inputs SlabVertices: list of Point3d, SlabThickness: Double, ConcreteMaterial: String, SlabPriority: Int32, TopOfConcrete: Double, SlabBehavior: Int32
# ---------- drawslab: Python ----------
"""Grasshopper Script Instance"""
import System
import Rhino
import Grasshopper

import rhinoscriptsyntax as rs



class MyComponent(Grasshopper.Kernel.GH_ScriptInstance):
    def RunScript(self,
            FilePath,
            SlabVertices: System.Collections.Generic.IEnumerable[Rhino.Geometry.Point3d],
            SlabThickness: float,
            ConcreteMaterial: str,
            SlabPriority: int,
            TopOfConcrete: float,
            SlabBehavior: int):
        # requirements: requests
        # env: C:\Program Files\Bentley\Engineering\RAM Concept CONNECT Edition\RAM Concept CONNECT Edition V8\python
        
        # RAM Concept API imports
        from ram_concept.concept import Concept
        from ram_concept.model import DesignCode
        from ram_concept.model import Model
        from ram_concept.model import StructureType
        from ram_concept.point_2D import Point2D
        from ram_concept.polygon_2D import Polygon2D
        from ram_concept.slab_area import DefaultSlabArea
        from ram_concept.slab_area import SlabAreaBehavior

        
        import os
        from pathlib import Path

        print("1")
        concept = Concept.start_concept(headless=True)
        model = concept.open_file(FilePath)
        
        print("1")
        cad_manager = model.cad_manager
        structure_layer = cad_manager.structure_layer

        default_slab_area = cad_manager.default_slab_area
        
        default_slab_area.thickness = SlabThickness
        default_slab_area.toc = TopOfConcrete
        if SlabBehavior ==1:
            default_slab_area.behavior = SlabAreaBehavior.ONE_WAY_SLAB
        else:
            default_slab_area.behavior = SlabAreaBehavior.TWO_WAY_SLAB
            print(SlabBehavior)

        concretes = model.concretes
        default_slab_area.concrete = concretes.concrete(ConcreteMaterial)
        default_slab_area.priority = SlabPriority
        default_slab_area.r_axis = 0.0

        # Add Slab in the project
        List1 = SlabVertices
        List2 = [Point2D(coord.X, coord.Y) for coord in List1]
        slab_location = Polygon2D(List2)
        slab_area = structure_layer.add_slab_area(slab_location)

        #model.generate_mesh()

        model.save_file(FilePath)
        concept.shut_down()
        return
# ---------- end drawslab ----------
drawcolumns = Script(
    FilePath=createnewfile.file_path,
    Column3DPoint=ghpython_script_7.base_points,
    b="24",
    d="24",
    height="9",
    ColumnAngle="0",
    ConcreteMaterial="3000 psi")  # -> out, a; inputs Column3DPoint: list of Point3d, b: Double, d: Double, height: Double, ColumnAngle: Boolean, ConcreteMaterial: String
# ---------- drawcolumns: Python ----------
"""Grasshopper Script Instance"""
import System
import Rhino
import Grasshopper

import rhinoscriptsyntax as rs



class MyComponent(Grasshopper.Kernel.GH_ScriptInstance):
    def RunScript(self,
            FilePath,
            Column3DPoint: System.Collections.Generic.IEnumerable[Rhino.Geometry.Point3d],
            b: float,
            d: float,
            height: float,
            ColumnAngle: bool,
            ConcreteMaterial: str):
        # requirements: requests
        # env: C:\Program Files\Bentley\Engineering\RAM Concept CONNECT Edition\RAM Concept CONNECT Edition V8\python
        
        # RAM Concept API imports
        from ram_concept.concept import Concept
        from ram_concept.model import DesignCode
        from ram_concept.model import Model
        from ram_concept.model import StructureType
        from ram_concept.point_2D import Point2D
        from ram_concept.polygon_2D import Polygon2D
        from ram_concept.slab_area import DefaultSlabArea
        from ram_concept.slab_area import SlabAreaBehavior

        
        import os
        from pathlib import Path

        concept = Concept.start_concept(headless=True)
        model = concept.open_file(FilePath)
        
        cad_manager = model.cad_manager
        structure_layer = cad_manager.structure_layer

        default_slab_area = cad_manager.default_slab_area
        
            # set the values for columns to be added
        default_column = cad_manager.default_column
        default_column.angle = ColumnAngle
        default_column.below_slab = True
        default_column.compressible = True
        concretes = model.concretes
        default_slab_area.concrete = concretes.concrete(ConcreteMaterial)
        default_column.b = b
        default_column.d = d
        default_column.height = height
        default_column.i_factor = 1.0
        default_column.fixed_near = True
        default_column.fixed_far = True
        default_column.roller = False
        default_column.use_specified_LLR_parameters = False

        List1 = Column3DPoint
        List2 = [Point2D(coord.X, coord.Y) for coord in List1]

        column_points = List2
        for column_point in column_points:
            structure_layer.add_column(column_point)
        default_column.below_slab = False
        for column_point in column_points:
            structure_layer.add_column(column_point)

        #model.generate_mesh()

        model.save_file(FilePath)
        concept.shut_down()
        return
# ---------- end drawcolumns ----------
drawwalls = Script(FilePath=createnewfile.file_path, Wall3DPoint=merge_2, t="24", height="9", ConcreteMaterial="3000 psi")  # -> out, a; inputs Wall3DPoint: tree of Point3d, t: Double, height: Double, ConcreteMaterial: String
# ---------- drawwalls: Python ----------
"""Grasshopper Script Instance"""
import System
import Rhino
import Grasshopper

import rhinoscriptsyntax as rs



class MyComponent(Grasshopper.Kernel.GH_ScriptInstance):
    def RunScript(self,
            FilePath,
            Wall3DPoint: Grasshopper.DataTree[Rhino.Geometry.Point3d],
            t: float,
            height: float,
            ConcreteMaterial: str):
        # requirements: requests
        # env: C:\Program Files\Bentley\Engineering\RAM Concept CONNECT Edition\RAM Concept CONNECT Edition V8\python
        
        # RAM Concept API imports
        from ram_concept.concept import Concept
        from ram_concept.model import DesignCode
        from ram_concept.model import Model
        from ram_concept.model import StructureType
        from ram_concept.point_2D import Point2D
        from ram_concept.polygon_2D import Polygon2D
        from ram_concept.slab_area import DefaultSlabArea
        from ram_concept.slab_area import SlabAreaBehavior
        from ram_concept.line_segment_2D import LineSegment2D

        
        import os
        from pathlib import Path
        
        concept = Concept.start_concept(headless=True)
        model = concept.open_file(FilePath)
        
        cad_manager = model.cad_manager
        structure_layer = cad_manager.structure_layer
        
        default_wall = cad_manager.default_wall
        default_wall.below_slab = True
        default_wall.compressible = True
        concretes = model.concretes
        concrete_45 = concretes.concrete(ConcreteMaterial)
        default_wall.height = height
        default_wall.fixed_near = False
        default_wall.fixed_far = False
        default_wall.shear_wall = True
        default_wall.thickness = t
        default_wall.use_specified_LLR_parameters = False
        
        b=[]
        c=[]
        for i in range(Wall3DPoint.BranchCount):
            branchList = Wall3DPoint.Branch(i)
                      

            for j in range(branchList.Count):
                s = branchList[j]
                #print(s)
                List1 = Point2D(s.X, s.Y)
                b.append(List1)
            c.append(b)
            b=[]
        
        print(len(c))
        
        for walls in range(len(c)):
            
            
            
            pt1 = c[walls][0]
            pt2 = c[walls][1]
            print(pt1,pt2)
            structure_layer.add_wall(LineSegment2D(pt1,pt2))
        
            



        #model.generate_mesh()

        model.save_file(FilePath)
        concept.shut_down()
        return
# ---------- end drawwalls ----------
drawwalls_2 = Script(FilePath=createnewfile.file_path, Wall3DPoint=merge, t="24", height="9", ConcreteMaterial="3000 psi")  # -> out, a; inputs Wall3DPoint: tree of Point3d, t: Double, height: Double, ConcreteMaterial: String
# ---------- drawwalls_2: Python ----------
"""Grasshopper Script Instance"""
import System
import Rhino
import Grasshopper

import rhinoscriptsyntax as rs



class MyComponent(Grasshopper.Kernel.GH_ScriptInstance):
    def RunScript(self,
            FilePath,
            Wall3DPoint: Grasshopper.DataTree[Rhino.Geometry.Point3d],
            t: float,
            height: float,
            ConcreteMaterial: str):
        # requirements: requests
        # env: C:\Program Files\Bentley\Engineering\RAM Concept CONNECT Edition\RAM Concept CONNECT Edition V8\python
        
        # RAM Concept API imports
        from ram_concept.concept import Concept
        from ram_concept.model import DesignCode
        from ram_concept.model import Model
        from ram_concept.model import StructureType
        from ram_concept.point_2D import Point2D
        from ram_concept.polygon_2D import Polygon2D
        from ram_concept.slab_area import DefaultSlabArea
        from ram_concept.slab_area import SlabAreaBehavior
        from ram_concept.line_segment_2D import LineSegment2D

        
        import os
        from pathlib import Path
        
        concept = Concept.start_concept(headless=True)
        model = concept.open_file(FilePath)
        
        cad_manager = model.cad_manager
        structure_layer = cad_manager.structure_layer
        
        default_wall = cad_manager.default_wall
        default_wall.below_slab = False
        default_wall.compressible = True
        concretes = model.concretes
        concrete_45 = concretes.concrete(ConcreteMaterial)
        default_wall.height = height
        default_wall.fixed_near = False
        default_wall.fixed_far = False
        default_wall.shear_wall = True
        default_wall.thickness = t
        default_wall.use_specified_LLR_parameters = False
        
        b=[]
        c=[]
        for i in range(Wall3DPoint.BranchCount):
            branchList = Wall3DPoint.Branch(i)
                      

            for j in range(branchList.Count):
                s = branchList[j]
                #print(s)
                List1 = Point2D(s.X, s.Y)
                b.append(List1)
            c.append(b)
            b=[]
        
        print(len(c))
        
        for walls in range(len(c)):
            
            
            
            pt1 = c[walls][0]
            pt2 = c[walls][1]
            print(pt1,pt2)
            structure_layer.add_wall(LineSegment2D(pt1,pt2))
        
            



        model.generate_mesh()

        model.save_file(FilePath)
        concept.shut_down()
        return
# ---------- end drawwalls_2 ----------
drawopening = Script(FilePath=createnewfile.file_path, SlabVertices=discontinuity.Points)  # -> out, a; inputs SlabVertices: list of Point3d
# ---------- drawopening: Python ----------
"""Grasshopper Script Instance"""
import System
import Rhino
import Grasshopper

import rhinoscriptsyntax as rs



class MyComponent(Grasshopper.Kernel.GH_ScriptInstance):
    def RunScript(self,
            FilePath,
            SlabVertices: System.Collections.Generic.IEnumerable[Rhino.Geometry.Point3d]):
        # requirements: requests
        # env: C:\Program Files\Bentley\Engineering\RAM Concept CONNECT Edition\RAM Concept CONNECT Edition V8\python
        
        # RAM Concept API imports
        from ram_concept.concept import Concept
        from ram_concept.model import DesignCode
        from ram_concept.model import Model
        from ram_concept.model import StructureType
        from ram_concept.point_2D import Point2D
        from ram_concept.polygon_2D import Polygon2D
        from ram_concept.slab_area import DefaultSlabArea
        from ram_concept.slab_opening import DefaultSlabOpening
        from ram_concept.slab_area import SlabAreaBehavior

        
        import os
        from pathlib import Path

        concept = Concept.start_concept(headless=True)
        model = concept.open_file(FilePath)
        
        cad_manager = model.cad_manager
        structure_layer = cad_manager.structure_layer

        default_slab_opening = cad_manager.default_slab_opening
        

        # Add Slab in the project
        List1 = SlabVertices
        List2 = [Point2D(coord.X, coord.Y) for coord in List1]
        print("jksdf")
        slab_location = Polygon2D(List2)
        print(slab_location)
        #slab_area = structure_layer.add_slab_area(slab_location)
        slab_area = structure_layer.add_slab_opening(slab_location)
        

        model.generate_mesh()

        model.save_file(FilePath)
        concept.shut_down()
        return
# ---------- end drawopening ----------
